# Dynamo graph testFile.dyn (Dynamo 3.3.0.6316)

code_block = CodeBlock { 5; 4; }
byWidthLength = Rectangle.ByWidthLength(width=code_block.out0, length=code_block.out1)
code_block_2 = CodeBlock { Plane.ByOriginNormal(Point.ByCoordinates(0,0,0),Vector.ByCoordinates(0,0,1)); }
number_slider = DoubleSlider(0, range=0..100 step 0.1)
rotate = Geometry.Rotate(geometry=byWidthLength, basePlane=code_block_2, degrees=number_slider)
code_block_3 = CodeBlock { 3; }
extrude = Curve.Extrude(curve=rotate, distance=code_block_3)
code_block_4 = CodeBlock(x=extrude) { x.Faces; }
surfaceGeometry = Face.SurfaceGeometry(face=code_block_4)
code_block_5 = CodeBlock { [0,2,3]; }
getItemAtIndex = List.GetItemAtIndex(list=surfaceGeometry, index=code_block_5)
code_block_6 = CodeBlock { 0.5; }
pointAtParameter = Surface.PointAtParameter(surface=surfaceGeometry, u=code_block_6, v=code_block_6)
normalAtParameter = Surface.NormalAtParameter(surface=surfaceGeometry, u=code_block_6, v=code_block_6)
byOriginNormal = Plane.ByOriginNormal(origin=pointAtParameter, normal=normalAtParameter)
getItemAtIndex_2 = List.GetItemAtIndex(list=byOriginNormal, index=code_block_5)
code_block_7 = CodeBlock { 0.6; }
scale = Geometry.Scale(geometry=getItemAtIndex, plane=getItemAtIndex_2, xamount=code_block_7, yamount=code_block_7, zamount=code_block_7)
perimeterCurves = Surface.PerimeterCurves(surface=scale)
code_block_8 = CodeBlock { "F1"; "Double Pane Glazing"; 0.29; }
code_block_9 = CodeBlock { "Glass"; 1.053; 8; 6; }
fluxMaterial = DynaFlux.Build.FluxMaterial.FluxMaterial(name=code_block_9.out0, thermalConductivity=code_block_9.out1, thickness=code_block_9.out2)
code_block_10 = CodeBlock { "Air Gap"; 0.11; 5; }
fluxMaterial_2 = DynaFlux.Build.FluxMaterial.FluxMaterial(name=code_block_10.out0, thermalConductivity=code_block_10.out1, thickness=code_block_10.out2)
fluxMaterial_3 = DynaFlux.Build.FluxMaterial.FluxMaterial(name=code_block_9.out0, thermalConductivity=code_block_9.out1, thickness=code_block_9.out3)
list_create = List.Create(item0=fluxMaterial, item1=fluxMaterial_2, item2=fluxMaterial_3)
fluxConstruction = DynaFlux.Build.FluxConstruction.FluxConstruction(id=code_block_8.out0, name=code_block_8.out1, materials=list_create, shadingCoefficient=code_block_8.out2)
uvalue = DynaFlux.Build.FluxConstruction.Uvalue(fluxConstruction=fluxConstruction)
code_block_11 = CodeBlock { "F1"; "Double Pane Glazing"; 5.12; }
fluxConstruction_2 = DynaFlux.Build.FluxConstruction.FluxConstruction(id=code_block_11.out0, name=code_block_11.out1, uvalue=code_block_11.out2)  # unwired: materials
shadingCoefficient = DynaFlux.Build.FluxConstruction.ShadingCoefficient(fluxConstruction=fluxConstruction_2)
difference = Surface.Difference(surface=surfaceGeometry, others=scale)
code_block_12 = CodeBlock(x=difference) { x.Faces; }
flatten = List.Flatten(list=code_block_12)
create = DynaFlux.Build.FluxSurface.Create(face=flatten, construction=fluxConstruction_2)
area = DynaFlux.Build.FluxSurface.Area(fluxSurface=create)
construction = DynaFlux.Build.FluxSurface.Construction(fluxSurface=create)
face = DynaFlux.Build.FluxSurface.Face(fluxSurface=create)
orientation = DynaFlux.Build.FluxSurface.Orientation(fluxSurface=create)
angle = DynaFlux.Build.FluxOrientation.Angle(fluxOrientation=orientation)
correctionFactor = DynaFlux.Build.FluxOrientation.CorrectionFactor(fluxOrientation=orientation)
name = DynaFlux.Build.FluxOrientation.Name(fluxOrientation=orientation)
normal = DynaFlux.Build.FluxOrientation.Normal(fluxOrientation=orientation)
code_block_13 = CodeBlock {  }
code_block_14 = CodeBlock { "Concrete"; 0.144; 110; }
fluxMaterial_4 = DynaFlux.Build.FluxMaterial.FluxMaterial(name=code_block_14.out0, thermalConductivity=code_block_14.out1, thickness=code_block_14.out2)
uvalue_2 = DynaFlux.Build.FluxConstruction.Uvalue(fluxConstruction=fluxConstruction_2)
code_block_15 = CodeBlock(x=scale) { x.Faces; }
flatten_2 = List.Flatten(list=code_block_15)
create_2 = DynaFlux.Build.FluxSurface.Create(face=flatten_2, construction=fluxConstruction)
orientation_2 = DynaFlux.Build.FluxSurface.Orientation(fluxSurface=create_2)
name_2 = DynaFlux.Build.FluxOrientation.Name(fluxOrientation=orientation_2)
normal_2 = DynaFlux.Build.FluxOrientation.Normal(fluxOrientation=orientation_2)
correctionFactor_2 = DynaFlux.Build.FluxOrientation.CorrectionFactor(fluxOrientation=orientation_2)
angle_2 = DynaFlux.Build.FluxOrientation.Angle(fluxOrientation=orientation_2)
construction_2 = DynaFlux.Build.FluxSurface.Construction(fluxSurface=create_2)
face_2 = DynaFlux.Build.FluxSurface.Face(fluxSurface=create_2)
area_2 = DynaFlux.Build.FluxSurface.Area(fluxSurface=create_2)
