# Dynamo graph testFile2.dyn (Dynamo 3.3.0.6316)

code_block = CodeBlock { 5; 4; }
byWidthLength = Rectangle.ByWidthLength(width=code_block.out0, length=code_block.out1)
code_block_2 = CodeBlock { Plane.ByOriginNormal(Point.ByCoordinates(0,0,0),Vector.ByCoordinates(0,0,1)); }
number_slider = DoubleSlider(0, range=0..100 step 0.1)
rotate = Geometry.Rotate(geometry=byWidthLength, basePlane=code_block_2, degrees=number_slider)
code_block_3 = CodeBlock { 3; }
extrude = Curve.Extrude(curve=rotate, distance=code_block_3)
code_block_4 = CodeBlock(x=extrude) { x.Faces; }
surfaceGeometry = Face.SurfaceGeometry(face=code_block_4)
code_block_5 = CodeBlock { [0,1,2,3]; }
getItemAtIndex = List.GetItemAtIndex(list=surfaceGeometry, index=code_block_5)
code_block_6 = CodeBlock { 0.5; }
pointAtParameter = Surface.PointAtParameter(surface=surfaceGeometry, u=code_block_6, v=code_block_6)
normalAtParameter = Surface.NormalAtParameter(surface=surfaceGeometry, u=code_block_6, v=code_block_6)
byOriginNormal = Plane.ByOriginNormal(origin=pointAtParameter, normal=normalAtParameter)
getItemAtIndex_2 = List.GetItemAtIndex(list=byOriginNormal, index=code_block_5)
code_block_7 = CodeBlock { 0.65; }
scale = Geometry.Scale(geometry=getItemAtIndex, plane=getItemAtIndex_2, xamount=code_block_7, yamount=code_block_7, zamount=code_block_7)
perimeterCurves = Surface.PerimeterCurves(surface=scale)
code_block_8 = CodeBlock {  }
code_block_9 = CodeBlock { "TestBox"; }
code_block_10 = CodeBlock(x=scale) { x.Faces; }
flatten = List.Flatten(list=code_block_10)
code_block_11 = CodeBlock()
# ---------- code_block_11.designscript (4 lines) ----------
"F1";
"Double Pane Glazing";
0.3;
// SC;
# ----------------------------------------
code_block_12 = CodeBlock { "Glass"; 1.053; 8; 6; }
fluxMaterial = DynaFlux.Build.FluxMaterial.FluxMaterial(name=code_block_12.out0, thermalConductivity=code_block_12.out1, thickness=code_block_12.out2)
code_block_13 = CodeBlock { "Air Gap"; 0.11; 5; }
fluxMaterial_2 = DynaFlux.Build.FluxMaterial.FluxMaterial(name=code_block_13.out0, thermalConductivity=code_block_13.out1, thickness=code_block_13.out2)
fluxMaterial_3 = DynaFlux.Build.FluxMaterial.FluxMaterial(name=code_block_12.out0, thermalConductivity=code_block_12.out1, thickness=code_block_12.out3)
list_create = List.Create(item0=fluxMaterial, item1=fluxMaterial_2, item2=fluxMaterial_3)
code_block_14 = CodeBlock { 0.36; }
byMaterials = DynaFlux.Build.FluxConstruction.ByMaterials(id=code_block_11.out0, name=code_block_11.out1, materials=list_create, sc1=code_block_14)
create = DynaFlux.Build.FluxSurface.Create(face=flatten, construction=byMaterials)
difference = Surface.Difference(surface=surfaceGeometry, others=scale)
code_block_15 = CodeBlock(x=difference) { x.Faces; }
flatten_2 = List.Flatten(list=code_block_15)
code_block_16 = CodeBlock { "W1"; "Brick"; 0.12; }
byUvalue = DynaFlux.Build.FluxConstruction.ByUvalue(id=code_block_16.out0, name=code_block_16.out1, uvalue=code_block_16.out2)
create_2 = DynaFlux.Build.FluxSurface.Create(face=flatten_2, construction=byUvalue)
list_create_2 = List.Create(item0=create, item1=create_2)
flatten_3 = List.Flatten(list=list_create_2)
fluxModel = DynaFlux.Build.FluxModel.FluxModel(projectName=code_block_9, surfaces=flatten_3)
surfaces = DynaFlux.Build.FluxModel.Surfaces(fluxModel=fluxModel)
construction = DynaFlux.Build.FluxSurface.Construction(fluxSurface=surfaces)
type = DynaFlux.Build.FluxConstruction.Type(fluxConstruction=construction)
id = DynaFlux.Build.FluxConstruction.Id(fluxConstruction=construction)
materials = DynaFlux.Build.FluxConstruction.Materials(fluxConstruction=construction)
fluxModelEttvResult = DynaFlux.Result.FluxModelEttvResult.FluxModelEttvResult(model=fluxModel)
resultPerOrientation = DynaFlux.Result.FluxModelEttvResult.ResultPerOrientation(fluxModelEttvResult=fluxModelEttvResult)
fenestrationConductionHeatGain = DynaFlux.Result.FluxOrientationEttvResult.FenestrationConductionHeatGain(fluxOrientationEttvResult=resultPerOrientation)
watch = Watch(fenestrationConductionHeatGain)
fenestrationRadiationHeatGain = DynaFlux.Result.FluxOrientationEttvResult.FenestrationRadiationHeatGain(fluxOrientationEttvResult=resultPerOrientation)
watch_2 = Watch(fenestrationRadiationHeatGain)
opaqueConductionHeatGain = DynaFlux.Result.FluxOrientationEttvResult.OpaqueConductionHeatGain(fluxOrientationEttvResult=resultPerOrientation)
watch_3 = Watch(opaqueConductionHeatGain)
orientation = DynaFlux.Build.FluxSurface.Orientation(fluxSurface=surfaces)
angle = DynaFlux.Build.FluxOrientation.Angle(fluxOrientation=orientation)
correctionFactor = DynaFlux.Build.FluxOrientation.CorrectionFactor(fluxOrientation=orientation)
orientation_2 = DynaFlux.Build.FluxSurface.Orientation(fluxSurface=create_2)
correctionFactor_2 = DynaFlux.Build.FluxOrientation.CorrectionFactor(fluxOrientation=orientation_2)
construction_2 = DynaFlux.Build.FluxSurface.Construction(fluxSurface=create_2)
type_2 = DynaFlux.Build.FluxConstruction.Type(fluxConstruction=construction_2)
resultPerOrientation_2 = DynaFlux.Result.FluxModelEttvResult.ResultPerOrientation()  # unwired: fluxModelEttvResult
grossArea = DynaFlux.Result.FluxOrientationEttvResult.GrossArea(fluxOrientationEttvResult=resultPerOrientation)
opaqueArea = DynaFlux.Result.FluxOrientationEttvResult.OpaqueArea(fluxOrientationEttvResult=resultPerOrientation)
fenestrationArea = DynaFlux.Result.FluxOrientationEttvResult.FenestrationArea(fluxOrientationEttvResult=resultPerOrientation)
wwr = DynaFlux.Result.FluxOrientationEttvResult.Wwr(fluxOrientationEttvResult=resultPerOrientation)
uniqueConstructions = DynaFlux.Result.FluxOrientationEttvResult.UniqueConstructions(fluxOrientationEttvResult=resultPerOrientation)
id_2 = DynaFlux.Build.FluxConstruction.Id(fluxConstruction=uniqueConstructions)
name = DynaFlux.Build.FluxConstruction.Name(fluxConstruction=uniqueConstructions)
boolean = BoolSelector(true)
generateReport = DynaFlux.Report.EttvReport.GenerateReport(result=fluxModelEttvResult, run=boolean)
watch_4 = Watch(generateReport)
